# Grasshopper definition Tether_v0.6.gh (Grasshopper 1.0.7)
# plug-ins: Heteroptera, Geospatial, Human UI, Pufferfish, Human, gHowl, LunchBox

panel = Panel("""trajectory
pause
map
looking_around
asking directions""")

# ---- group: Timer settings
# RECEIVE OSC
timer = Timer(TimerInterval=500)

# ----
# MAIN UI
panel_2 = Panel("timestamp")
timeline = Slider(3, range=0..100)
udp_receiver = UDPReceiver(Address="127.0.0.1", Port="12000", Pattern="999")  # -> Info, Data
create_label = CreateLabel(LabelText="Length: ", LabelSize=12, Justification=0)
create_label_2 = CreateLabel(LabelText="Point count: ", LabelSize=12, Justification=0)
create_text_box = CreateTextBox(Label="Participant", DefaultText="enter participant id", UpdateButton=False, showLabel=True)
behaviour_types = CreateListBox(ListItems=panel, SelectedIndex=0, Height=150)
my_slidererb = CreateSlider(Slider=timeline, SnapValue=1, ShowBounds=True, ShowTicks=True, ShowTooltip=True, ShowValLabel=True, showLabel=True)
create_label_3 = CreateLabel(LabelText="Set Point Type", LabelSize=18, Justification=0)
create_label_4 = CreateLabel(LabelText="Trajectory ", LabelSize=18, Justification=0)
create_button = CreateButton(ButtonName="backwards", ButtonStyle=1)
create_button_2 = CreateButton(ButtonName="play | pause", ButtonStyle=1)
create_button_3 = CreateButton(ButtonName="forward", ButtonStyle=1)
create_label_5 = CreateLabel(LabelText=panel_2, LabelSize=12, Justification=0)
create_label_6 = CreateLabel(LabelText="current layer:", LabelSize=12, Justification=0)
create_toggle = CreateToggle(Default=True, Label="show point info")
panel_3 = Panel(udp_receiver.Data)
panel_4 = Panel(udp_receiver.Info)
merge = Merge(Data1=create_button, Data2=create_button_2, Data3=create_button_3)
timer_2 = Timer(TimerInterval=1000, Target=c_script)
c_script = CSharpScript()  # -> out, CurrentLayer
# ---------- c_script: C# ----------
    CurrentLayer = RhinoDocument.Layers.CurrentLayer;
# ---------- end c_script ----------
list_item = ListItem(List=udp_receiver.Data, Index="1", Wrap=True)  # -> flatten(Item)
concatenate = Concatenate(FragmentA="current layer:", FragmentB=c_script.CurrentLayer, JoinSeparator=" ")
data_dam = DataDam(DataDataA=list_item, BufferDelay=2500000, BufferMode=2)  # disabled
set_label_contents = SetLabelContents(LabelToModify=create_label_6, NewLabelContents=concatenate)
round_to_decimal_place = RoundToDecimalPlace(NumberX=list_item, DecimalPlace=1, RoundType=0)  # -> Rounded, Difference
concatenate_2 = Concatenate(FragmentA="timestamp: ", FragmentB=round_to_decimal_place.Rounded)
set_label_contents_2 = SetLabelContents(LabelToModify=create_label_5, NewLabelContents=concatenate_2)
panel_5 = Panel("+ 5")

panel_6 = Panel("""1*
1*
1*""")
panel_7 = Panel("""1*
1*
1*""")
panel_8 = Panel("""0
0
0""")
panel_9 = Panel("""0
1
2""")
create_grid = CreateGrid(
    UIElements=merge,
    Width="370",
    RowDefinitions=panel_6,
    ColumnDefinitions=panel_7,
    ElementRow=panel_8,
    ElementColumn=panel_9,
    ElementRowSpan=1,
    ElementColumnSpan=370)

panel_10 = Panel("- 5")
panel_11 = Panel("play ")
value_listener = ValueListener(Elements=create_button_3, SomeProperty=True)  # -> Values, Indices
value_listener_2 = ValueListener(Elements=create_button_2, SomeProperty=True)  # -> Values, Indices
value_listener_3 = ValueListener(Elements=create_button, SomeProperty=True)  # -> Values, Indices
value_listener_4 = ValueListener(Elements=my_slidererb, SomeProperty=True)  # -> Values, Indices
panel_12 = Panel(value_listener_3.Values)
panel_13 = Panel(value_listener.Values)
panel_14 = Panel(value_listener_2.Values)
merge_2 = Merge(
    Data1=create_label_5,
    Data2=create_label_6,
    Data3=create_text_box,
    Data4=create_toggle,
    Data5=create_label_3,
    Data6=behaviour_types,
    Data7=create_label_4,
    Data8=create_label_2,
    Data9=create_label,
    Data10=my_slidererb,
    Data13=create_grid)
# CONTROL PLAYBACK (PROCESSING)
panel_15 = Panel("32000")

# ---- group: backward
number = Number(value_listener_3.Values)
multiplication = Multiplication(A=number, B="-5")
panel_16 = Panel(["/control/time", multiplication])
stream_freeze_gate = StreamFreezeGate(Data=panel_16, PassingSwitch=number)
udp_sender = UDPSender(Address="127.0.0.1", Port=panel_15, Pattern="999", Data=stream_freeze_gate)

# ---- group: forward
number_2 = Number(value_listener.Values)
multiplication_2 = Multiplication(A=number_2, B="5")
panel_17 = Panel(["/control/time", multiplication_2])
stream_freeze_gate_2 = StreamFreezeGate(Data=panel_17, PassingSwitch=number_2)
udp_sender_2 = UDPSender(Address="127.0.0.1", Port=panel_15, Pattern="999", Data=stream_freeze_gate_2)

# ---- group: play
number_3 = Number(value_listener_2.Values)
panel_18 = Panel(["/control/play", number_3])
stream_freeze_gate_3 = StreamFreezeGate(Data=panel_18, PassingSwitch=number_3)
udp_sender_3 = UDPSender(Address="127.0.0.1", Port=panel_15, Pattern="999", Data=stream_freeze_gate_3)

# ---- group: slider
number_4 = Number(value_listener_4.Values)
panel_19 = Panel(["/control/slider", number_4])
udp_sender_4 = UDPSender(Address="127.0.0.1", Port=panel_15, Pattern="999", Data=panel_19)

# ----
panel_20 = Panel(udp_sender)
launch_window = LaunchWindow(Show=Toggle(True), Name="Tether v0.6", Width=370, Height=500, ChildStatus=2, EnableHorizScroll=False)
panel_21 = Panel("""input
export""")
create_file_picker = CreateFilePicker(ButtonLabelText="Select folder", DialogType=2, MustExist=True, Filter="All Files|*.*")
value_listener_5 = ValueListener(Elements=create_file_picker, NameFilterS="Select folder", SomeProperty=True)  # -> Values, Indices
value_listener_6 = ValueListener(Elements=create_toggle, SomeProperty=True)  # -> Values, Indices
value_listener_7 = ValueListener(Elements=create_text_box, NameFilterS="TextBox: Participant", SomeProperty=True)  # -> Values, Indices
value_listener_8 = ValueListener(Elements=behaviour_types, NameFilterS="List Box", SomeProperty=True)  # -> Values, Indices

# ----
# ADD ATTRIBUTES TO NEW POINT
panel_22 = Panel("tether")
dynamic_geometry_pipeline = DynamicGeometryPipeline(
    LayerFilter=panel_22,
    TypeFilter="Point",
    GroupByLayer=False,
    GroupByType=False,
    IncludeHidden=True,
    IncludeLocked=True,
    enableFullPath=False,
    listenToAttributes=True)
merge_3 = Merge(Data1=value_listener_7.Values, Data2=value_listener_8.Values, Data3=list_item)  # -> flatten(Result)
panel_23 = Panel(merge_3)
point = Point(dynamic_geometry_pipeline)
panel_24 = Panel("""participant
behaviour_type
timestamp""")
createattributes = CreateAttributes(
    Name=value_listener_7.Values,
    LayerName=panel_22,
    UserDataKeys=flatten(panel_24),
    UserDataValues=merge_3,
    enableFullPath=False)
modify_object_attributes = ModifyObjectAttributes(Objects=point, Attributes=createattributes)

# ----
# EXPORT
timer_3 = Timer(TimerInterval=1000, Target=layer_information)
layer_information = LayerInformation(ReferenceToggle=True)  # -> flatten(Names), DisplayColors, GUID
null_item = NullItem(Item=layer_information.Names)  # -> NullFlags, InvalidFlags, Description
create_list_box = CreateListBox(ListItems="Default", SelectedIndex=0, Height=100)
create_button_4 = CreateButton(ButtonName="Export to CSV", ButtonStyle=3)
create_label_7 = CreateLabel(LabelText="Choose Layer to export", LabelSize=12, Justification=0)
cull_pattern = CullPattern(List=layer_information.Names, CullPattern=invert(null_item.NullFlags))
panel_25 = Panel(cull_pattern)
value_listener_9 = ValueListener(Elements=create_list_box, NameFilterS="List Box 1", SomeProperty=True)  # -> Values, Indices
value_listener_10 = ValueListener(Elements=create_button_4, NameFilterS="Export to CSV", SomeProperty=True)  # -> Values, Indices
merge_4 = Merge(Data1=create_label_7, Data2=create_list_box, Data3=create_file_picker, Data4=create_button_4)
set_list_contents = SetListContents(ListToModify=create_list_box, NewListContents=cull_pattern)
panel_26 = Panel(value_listener_10.Values)
panel_27 = Panel(value_listener_9.Values)
panel_28 = Panel("1")
panel_29 = Panel("""layer
participant
x
y
z
timestamp
annotation_type""")
timer_4 = Timer(TimerInterval=1000, Target=time)
time = Time("Now")
deconstruct_date = DeconstructDate(Date=time)  # -> Year, Month, Day, Hour, Minute, Second
concatenate_3 = Concatenate(
    Fragment_A=deconstruct_date.Year,
    Fragment_B=deconstruct_date.Month,
    A=deconstruct_date.Day,
    B="_",
    C=deconstruct_date.Hour,
    D=deconstruct_date.Minute,
    E=deconstruct_date.Second)
concatenate_4 = Concatenate(Fragment_A=value_listener_9.Values, B="_timestampted_coordinates-", Fragment_B=concatenate_3, A=".csv")
file_path = FilePath(value_listener_5.Values)
panel_30 = Panel(concatenate_4)

dynamic_geometry_pipeline_2 = DynamicGeometryPipeline(
    LayerFilter=value_listener_9.Values,
    TypeFilter="Point",
    NameFilter="*",
    GroupByLayer=False,
    GroupByType=False,
    IncludeHidden=True,
    IncludeLocked=True,
    enableFullPath=False,
    listenToAttributes=True)
tabbed_view = TabbedView(TabNames=panel_21, Tab0=flatten(merge_2), Tab1=flatten(merge_4))
add_elements = AddElements(Window=launch_window, Elements=flatten(tabbed_view), DoVLChecking=False)  # -> AddedElements, ElementNames
value_listener_11 = ValueListener(Elements=add_elements.AddedElements, SomeProperty=True)  # -> Values, Indices

object_attributes = ObjectAttributes(ObjectOrAttributes=dynamic_geometry_pipeline_2)  # -> Name, LayerName, LayerFullPath, Color, MaterialName, LinetypeName, GroupIndices, PlotWeight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
deconstruct = Deconstruct(Point=dynamic_geometry_pipeline_2)  # -> XComponent, YComponent, ZComponent
panel_31 = Panel(object_attributes.UserDataValues)

list_item_2 = ListItem(List=object_attributes.UserDataValues, Index=0, Wrap=True)  # -> flatten(Item)
list_item_3 = ListItem(List=object_attributes.UserDataValues, Index=1, Wrap=True)  # -> flatten(Item)
list_item_4 = ListItem(List=object_attributes.UserDataValues, Index=2, Wrap=True)  # -> flatten(Item)

entwine = Entwine(
    Branch0X=panel_27,
    Branch1X=list_item_2,
    Branch2X=deconstruct.XComponent,
    Branch3X=deconstruct.YComponent,
    Branch4X=deconstruct.ZComponent,
    Branch5X=list_item_4,
    Branch6X=list_item_3,
    FlattenInputs=False)
create_csv = CreateCSV(DataGridHeaders=panel_29, ValueTree=entwine, Delimiter=",")
panel_32 = Panel(create_csv)
write_file = WriteFile(Directory=file_path, Filename=concatenate_4, Data=create_csv, Run=value_listener_10.Values)

# ----
# VISUALISE POLYLINE
# 1. retrieve object (point) attributes
# 
# attribute 0 is the timestamp
# attribute 1 is the point
geometry_pipeline = GeometryPipeline(
    GroupByLayer=False,
    GroupByType=False,
    IncludeHidden=True,
    IncludeLocked=True,
    LayerFilter="tether",
    NameFilter="*",
    SublayerFiltering=True,
    TypeFilter=1)
point_2 = Point(graft(geometry_pipeline))
object_attributes_2 = ObjectAttributes(ObjectOrAttributes=point_2)  # -> Name, LayerName, LayerFullPath, Color, MaterialName, LinetypeName, GroupIndices, PlotWeight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
list_item_5 = ListItem(List=object_attributes_2.UserDataValues, Index=1, Wrap=True)
list_item_6 = ListItem(List=object_attributes_2.UserDataValues, Index=0, Wrap=True)
list_item_7 = ListItem(List=object_attributes_2.UserDataValues, Index=2, Wrap=True)
match_text = MatchText(Text=list_item_5, Pattern="trajectory", Case=True)
cull_pattern_2 = CullPattern(List=list_item_7, CullPattern=match_text)
cull_pattern_3 = CullPattern(List=point_2, CullPattern=match_text)
list_length = ListLength(List=cull_pattern_3)
sort_list = SortList(Keys=flatten(cull_pattern_2), ValuesValuesA=flatten(cull_pattern_3))  # -> Keys, ValuesValuesA
expression = Expression(x=flatten(list_item_6), y=flatten(list_item_5), z=flatten(list_item_7), Expression="\"P\"& x & \", \" & y & \" \" & z")
unit_x = UnitX(Factor=1)
polyline = PolyLine(Vertices=sort_list.ValuesValuesA, Closed=False)
move = Move(Geometry=flatten(point_2), Motion=unit_x)  # -> Geometry, Transform
expression_2 = Expression(
    x=flatten(list_item_5),
    y=flatten(ColourSwatch(SwatchColor=RGB(206, 0, 73))),
    z=flatten(ColourSwatch(SwatchColor=RGB(56, 199, 0))),
    Expression="if(x = \"trajectory\", y, z)")
panel_33 = Panel(expression)
stream_gate = StreamGate(Stream=expression, Gate=value_listener_6.Values)  # -> Target0, Target1
length = Length(Curve=polyline)
custom_preview_lineweights = CustomPreviewLineweights(
    Geometry=polyline,
    Shader={diffuse=RGB(255, 105, 180), emission=RGB(76, 32, 54), shine=0.5, specular=RGB(255, 255, 255), transparency=0},
    Thickness=Slider(2, range=0..10),
    Absolute=False)
text_tag = TextTag(Location=move.Geometry, Text=stream_gate.Target1, Colour=expression_2)
round_to_decimal_place_2 = RoundToDecimalPlace(NumberX=length, DecimalPlace=1, RoundType=0)  # -> Rounded, Difference
list_item_8 = ListItem(List=udp_receiver.Data, Index="2", Wrap=True)  # -> flatten(Item)
concatenate_5 = Concatenate(FragmentA="Length: ", FragmentB=round_to_decimal_place_2.Rounded)
concatenate_6 = Concatenate(FragmentA="Point count: ", FragmentB=list_length)
panel_34 = Panel("""0
100""")
set_label_contents_3 = SetLabelContents(LabelToModify=create_label_2, NewLabelContents=concatenate_6)
set_label_contents_4 = SetLabelContents(LabelToModify=create_label, NewLabelContents=concatenate_5)

data_dam_2 = DataDam(DataA=list_item_8, BufferDelay=10000000, BufferMode=2)

set_slider = SetSlider(UISlider=my_slidererb, Value=data_dam_2, Range=panel_34)
